# Grasshopper definition 0724_RoomsToGraph.gh (Grasshopper 1.0.8)
# plug-ins: RhinoCodePluginGH, Heteroptera, RhinoInside.Revit.GH, TopologicGH

# ----
# For Hus28
# Rooms
built_in_categories = BuiltInCategories("autodesk.revit.category.local:rooms-1.0.0", SearchPattern="roo")
category_filter = CategoryFilter(Categories=built_in_categories, Inverted=False)
query_elements = QueryElements(Filter=category_filter)  # -> flatten(Elements), Count
spatial_element_identity = SpatialElementIdentity(SpatialElement=query_elements.Elements)  # -> Location, Placed, Number, Name, Level
text_split = TextSplit(Text=spatial_element_identity.Level, Separators=":")
list_item = ListItem(List=text_split, Index=0, Wrap=True)  # -> flatten(Item), Item1
text_trim = TextTrim(Text=list_item.Item1, Start=True, End=True)  # -> flatten(Result)
element_parameter = ElementParameter(Element=query_elements.Elements, Parameter="iaac_RoomLevel", Value=text_trim)  # -> Element, Value

# ----
# Doors
categories = BuiltInCategories("autodesk.revit.category.family:doors-1.0.0", LayoutLevel=2, SearchPattern="Door")  # disabled
catfltr = CategoryFilter(Categories=categories, Inverted=False)  # disabled
query_elements_2 = QueryElements(Filter=catfltr, Limit=100)  # -> Elements, Count; disabled
component_neighbours = ComponentNeighbours(Component=query_elements_2.Elements)  # -> FromRoom, ToRoom, Room, Space; disabled
element_name = ElementName(Element=component_neighbours.FromRoom)  # -> Element, Name; disabled
element_name_2 = ElementName(Element=component_neighbours.ToRoom)  # -> Element, Name; disabled
element_name_3 = ElementName(Element=component_neighbours.Room)  # -> Element, Name; disabled
panel = Panel(element_name_3.Name)  # disabled
panel_2 = Panel(element_name.Name)  # disabled
panel_3 = Panel(element_name_2.Name)  # disabled
panel_4 = Panel("iaac_Door_ToRoom")  # disabled
panel_5 = Panel("iaac_Door_FromRoom")  # disabled
text = Text(element_name_2.Name)  # disabled
text_2 = Text(element_name.Name)  # disabled
element_parameter_2 = ElementParameter(Element=query_elements_2.Elements, Parameter=panel_5, Value=text_2)  # -> Element, Value; disabled
element_parameter_3 = ElementParameter(Element=query_elements_2.Elements, Parameter=panel_4, Value=text)  # -> Element, Value; disabled

wall_system_family = WallSystemFamily({"Basic": 0, "Curtain": 1, "Stacked": 2}, selected="Basic")
query_walls = QueryWalls(WallSystemFamily=wall_system_family)
element_geometry = ElementGeometry(Elements=query_walls, DetailLevel=3)
deconstruct_brep = DeconstructBrep(Brep=element_geometry)  # -> Faces, Edges, Vertices
brep = Brep(flatten(deconstruct_brep.Faces))

spatial_element_geometry = SpatialElementGeometry(SpatialElement=simplify(flatten(query_elements.Elements)), BoundaryLocation=0)  # -> Geometry, TopFaces, SideFaces, BottomFaces
brep_2 = Brep(spatial_element_geometry.Geometry)

# ---- group: Rooms with stairs
built_in_categories_2 = BuiltInCategories("autodesk.revit.category.local:stairs-1.0.0", LayoutLevel=2, SearchPattern="Stairs")
catfltr_2 = CategoryFilter(Categories=built_in_categories_2, Inverted=False)
query_elements_3 = QueryElements(Filter=catfltr_2, Limit=100)  # -> Elements, Count
bounding_box = BoundingBox(Content=query_elements_3.Elements, Plane=PlaneXY(0, 0, 0))  # -> Box, Box_2
volume = Volume(Geometry=bounding_box.Box)  # -> Volume, Centroid
point_in_brep = PointInBrep(Brep=simplify(brep_2), Point=simplify(graft(volume.Centroid)), Strict=False)
python_3_script = Python3Script(x=point_in_brep)  # -> out, a; inputs x: tree of Boolean
# ---------- python_3_script: Python ----------
import ghpythonlib.treehelpers as th

x_list=th.tree_to_list(x, retrieve_base=lambda x: x)

a = []

for i, branch in enumerate(x_list):
    print(f"- Branch: {str(i)} -")

    for j, item in enumerate(branch):
        if i == 0:
            a.append(item)
        else:
            if item == True:
                a[j] = True
# ---------- end python_3_script ----------
cull_pattern = CullPattern(List=brep_2, CullPattern=python_3_script.a)

# ----
panel_6 = Panel("127")  # disabled
panel_7 = Panel("125")  # disabled
list_item_2 = ListItem(List=brep_2, Index=panel_7, Wrap=True)  # disabled
list_item_3 = ListItem(List=brep_2, Index=panel_6, Wrap=True)  # disabled
deconstruct_brep_2 = DeconstructBrep(Brep=list_item_3)  # -> Faces, Edges, Vertices; disabled
deconstruct_brep_3 = DeconstructBrep(Brep=brep_2)  # -> Faces, Edges, Vertices
deconstruct_brep_4 = DeconstructBrep(Brep=list_item_2)  # -> Faces, Edges, Vertices; disabled
point = Point(deconstruct_brep_2.Vertices)  # disabled
point_2 = Point(deconstruct_brep_3.Vertices)
point_3 = Point(deconstruct_brep_4.Vertices)  # disabled
deconstruct = Deconstruct(Point=point)  # -> XComponent, YComponent, ZComponent; disabled
deconstruct_2 = Deconstruct(Point=point_2)  # -> XComponent, YComponent, ZComponent
deconstruct_3 = Deconstruct(Point=point_3)  # -> XComponent, YComponent, ZComponent; disabled
inside = Panel("0")
min_max = MinMax(Number=deconstruct.ZComponent)  # -> Minimum, Maximum; disabled
min_max_2 = MinMax(Number=deconstruct_2.ZComponent)  # -> Minimum, Maximum
min_max_3 = MinMax(Number=deconstruct_3.ZComponent)  # -> Minimum, Maximum; disabled
equality = Equality(FirstNumber=deconstruct.ZComponent, SecondNumber=min_max.Minimum)  # -> Equality, Inequality; disabled
equality_2 = Equality(FirstNumber=deconstruct_2.ZComponent, SecondNumber=min_max_2.Minimum)  # -> Equality, Inequality
equality_3 = Equality(FirstNumber=deconstruct_3.ZComponent, SecondNumber=min_max_3.Minimum)  # -> Equality, Inequality; disabled
cull_pattern_2 = CullPattern(List=point, CullPattern=equality.Equality)  # -> flatten(List); disabled
cull_pattern_3 = CullPattern(List=point_2, CullPattern=equality_2.Equality)
cull_pattern_4 = CullPattern(List=point_3, CullPattern=equality_3.Equality)  # -> flatten(List); disabled
deconstruct_4 = Deconstruct(Point=cull_pattern_2)  # -> XComponent, YComponent, ZComponent; disabled
deconstruct_5 = Deconstruct(Point=cull_pattern_4)  # -> XComponent, YComponent, ZComponent; disabled
deconstruct_6 = Deconstruct(Point=cull_pattern_3)  # -> XComponent, YComponent, ZComponent
python_3_script_2 = Python3Script(x=deconstruct_4.XComponent, y=deconstruct_4.YComponent, z=deconstruct_4.ZComponent)  # -> out, a; inputs x: list of Double, y: list of Double, z: list of Double; disabled
# ---------- python_3_script_2: Python ----------
import topologicpy

a = []

for coord_x, coord_y, coord_z in zip(x, y, z):
    vertex = topologicpy.Vertex.Vertex.ByCoordinates(coord_x, coord_y, coord_z)
    a.append(vertex)
# ---------- end python_3_script_2 ----------
python_3_script_3 = Python3Script(x=deconstruct_5.XComponent, y=deconstruct_5.YComponent, z=deconstruct_5.ZComponent)  # -> out, a; inputs x: list of Double, y: list of Double, z: list of Double; disabled; same code as python_3_script_2
python_3_script_4 = Python3Script(x=python_3_script_2.a)  # -> out, a; inputs x: list; disabled
# ---------- python_3_script_4: Python ----------
import topologicpy

a = topologicpy.Face.Face.ByVertices(x)
# ---------- end python_3_script_4 ----------
python_3_script_5 = Python3Script(x=python_3_script_3.a)  # -> out, a; inputs x: list; disabled; same code as python_3_script_4
python_3_script_6 = Python3Script(x=deconstruct_6.XComponent, y=deconstruct_6.YComponent, z=deconstruct_6.ZComponent)  # -> out, VerticesOfRooms; inputs x: tree of Double, y: tree of Double, z: tree of Double
# ---------- python_3_script_6: Python ----------
import topologicpy

def data_tree_to_nested_list(data_tree, base_retrieval=lambda x: x[0]):
    """
    Converts a Grasshopper DataTree into a nested list structure.
    """
    def extend_list(path, depth, simple_data, nested_list):
        target_index = path[depth]
        if len(nested_list) <= target_index:
            nested_list.extend([None] * (target_index - len(nested_list) + 1))
        
        if depth == path.Length - 1:
            nested_list[target_index] = list(simple_data)
        else:
            if nested_list[target_index] is None:
                nested_list[target_index] = []
            extend_list(path, depth + 1, simple_data, nested_list[target_index])

    nested_structure = []
    for i in range(data_tree.BranchCount):
        branch_path = data_tree.Path(i)
        extend_list(branch_path, 0, data_tree.Branch(branch_path), nested_structure)
    
    return base_retrieval(nested_structure)

# Convert the Grasshopper DataTrees to nested lists
x_coords = data_tree_to_nested_list(x)
y_coords = data_tree_to_nested_list(y)
z_coords = data_tree_to_nested_list(z)

# Number of rooms to generate
total_rooms = len(x_coords)
print(f"Total Rooms to Generate: {total_rooms}")

# List to store rooms with vertices
VerticesOfRooms = []

# Iterate over the coordinate sets
for room_index, (x_set, y_set, z_set) in enumerate(zip(x_coords, y_coords, z_coords), start=1):
    print(f"Start Generation Room {room_index} / {total_rooms}")
    room_vertices = []
    for x, y, z in zip(x_set, y_set, z_set):
        # Create vertex from coordinates
        vertex = topologicpy.Vertex.Vertex.ByCoordinates(x, y, z)
        room_vertices.append(vertex)
    
    VerticesOfRooms.append(room_vertices)

# Output the generated vertex rooms
print("Generated Vertices of Rooms")
# ---------- end python_3_script_6 ----------
python_3_script_7 = Python3Script(x=python_3_script_4.a)  # -> out, a; disabled
# ---------- python_3_script_7: Python ----------
import topologicpy

a = topologicpy.Cell.Cell.ByThickenedFace(face = x, thickness = 2000, bothSides = False, reverse = True)
# ---------- end python_3_script_7 ----------
python_3_script_8 = Python3Script(x=python_3_script_5.a)  # -> out, a; disabled; same code as python_3_script_7
python_3_script_9 = Python3Script(topology=python_3_script_8.a)  # -> out, geometry; disabled
# ---------- python_3_script_9: Python ----------
from topologicpy.Topology import Topology
import Rhino.Geometry as rg

topology = Topology.Triangulate(topology)
d = Topology.Geometry(topology)

def create_mesh(vertices, edges, faces):
    # Create an empty mesh
    mesh = rg.Mesh()

    # Add vertices to the Mesh
    for vertex in vertices:
        mesh.Vertices.Add(vertex)

    # Add faces to the Brep
    for face in faces:
        mesh.Faces.AddFace(face[0], face[1], face[2])

    mesh.UnifyNormals()
    return mesh

verts = d["vertices"]
edges = d["edges"]
faces = d["faces"]

vertices = [rg.Point3d(v[0],v[1],v[2]) for v in verts]

# create the mesh
geometry = create_mesh(vertices, edges, faces)
# ---------- end python_3_script_9 ----------
panel_8 = Panel(python_3_script_6.out)
python_3_script_10 = Python3Script(topology=python_3_script_7.a)  # -> out, geometry; disabled; same code as python_3_script_9
python_3_script_11 = Python3Script(VerticesOfRooms=python_3_script_6.VerticesOfRooms)  # -> out, FacesOfRooms; inputs VerticesOfRooms: list
# ---------- python_3_script_11: Python ----------
import topologicpy

FacesOfRooms = []

for vertices in VerticesOfRooms:
    FaceOfRoom = topologicpy.Face.Face.ByVertices(vertices)
    FacesOfRooms.append(FaceOfRoom)
# ---------- end python_3_script_11 ----------
merge = Merge(Data2=python_3_script_8.a, Data3=python_3_script_7.a)  # disabled
panel_9 = Panel(python_3_script_10.geometry)  # disabled
panel_10 = Panel(python_3_script_9.geometry)  # disabled
panel_11 = Panel(python_3_script_11.FacesOfRooms)
python_3_script_12 = Python3Script(x=merge)  # -> out, a; inputs x: list; disabled
# ---------- python_3_script_12: Python ----------
import topologicpy

a = topologicpy.Cluster.Cluster.ByTopologies(x)
# ---------- end python_3_script_12 ----------
python_3_script_13 = Python3Script(x=merge)  # -> out, geometry; inputs x: list; disabled
# ---------- python_3_script_13: Python ----------
import topologicpy

topologicpy.Topology.Topology.ByGeometry(vertices = x)
# ---------- end python_3_script_13 ----------
unit_z = UnitZ(Factor="2800")
panel_12 = Panel(python_3_script_12.a)  # disabled
python_3_script_14 = Python3Script(FacesOfRooms=python_3_script_11.FacesOfRooms, Heigth="2000")  # -> out, flatten(CellsRooms); inputs FacesOfRooms: list, Heigth: Double
# ---------- python_3_script_14: Python ----------
import topologicpy

CellsRooms = []

for Face in FacesOfRooms:
    CellRoom = topologicpy.Cell.Cell.ByThickenedFace(face = Face, thickness = Heigth, bothSides = False, reverse = True)
    CellsRooms.append(CellRoom)
# ---------- end python_3_script_14 ----------
python_3_script_15 = Python3Script(CellsRooms=python_3_script_14.CellsRooms)  # -> out, CellComplex; inputs CellsRooms: list
# ---------- python_3_script_15: Python ----------
import topologicpy

CellComplex = topologicpy.CellComplex.CellComplex.ByCells(CellsRooms)
# ---------- end python_3_script_15 ----------
python_3_script_16 = Python3Script(CellsRooms=python_3_script_14.CellsRooms)  # -> out, Cluster; inputs CellsRooms: list
# ---------- python_3_script_16: Python ----------
import topologicpy

Cluster = topologicpy.Cluster.Cluster.ByTopologies(CellsRooms)
# ---------- end python_3_script_16 ----------
python_3_script_17 = Python3Script(topology=python_3_script_16.Cluster)  # -> out, geometry; same code as python_3_script_9
python_3_script_18 = Python3Script(x=python_3_script_16.Cluster)  # -> out, topo_Graph, topo_Graph_Vertices, topo_Graph_Edges
# ---------- python_3_script_18: Python ----------
from topologicpy.Graph import Graph

topo_Graph = Graph.ByTopology(x)

topo_Graph_Vertices = Graph.Vertices(topo_Graph)

topo_Graph_Edges = Graph.Edges(topo_Graph, topo_Graph_Vertices)
# ---------- end python_3_script_18 ----------
panel_13 = Panel("0.2")  # disabled
swatch = ColourSwatch(SwatchColor=RGB(255, 0, 0))  # disabled

built_in_categories_3 = BuiltInCategories("autodesk.revit.category.family:doors-1.0.0", LayoutLevel=2, SearchPattern="Door")
category_filter_2 = CategoryFilter(Categories=built_in_categories_3, Inverted=False)
panel_14 = Panel("""0
1""")
panel_15 = Panel("""4
5""")
panel_16 = Panel("""2
3""")
number_slider = Slider(352, range=0..1000)
number_slider_2 = Slider(300, range=0..1000)
number_slider_3 = Slider(99, range=0..1000)

# ----
# For Test_Model
levels_picker = LevelsPicker(<levels picker referenced from the Revit model>)
query_rooms = QueryRooms(Placed=True, Level=levels_picker)
level = Level(levels_picker)
spatial_element_geometry_2 = SpatialElementGeometry(SpatialElement=query_rooms, BoundaryLocation=0)  # -> Geometry, TopFaces, SideFaces, BottomFaces

level_filter = LevelFilter(Levels=level, Inverted=False)
logical_and_filter = LogicalAndFilter(FilterA=category_filter_2, FilterB=level_filter)

query_elements_4 = QueryElements(Filter=logical_and_filter, Limit=100)  # -> Elements, Count
element_geometry_2 = ElementGeometry(Elements=query_elements_4.Elements, DetailLevel=3)
bounding_box_2 = BoundingBox(Content=element_geometry_2, Plane=PlaneXY(0, 0, 0), UnionBox=True)  # -> Box, Box_2
deconstruct_brep_5 = DeconstructBrep(Brep=bounding_box_2.Box)  # -> Faces, Edges, Vertices
area = Area(Geometry=deconstruct_brep_5.Faces)  # -> Area, Centroid
sort_list = SortList(Keys=area.Area, ValuesValuesA=deconstruct_brep_5.Faces)  # -> Keys, ValuesValuesA
list_item_4 = ListItem(List=sort_list.ValuesValuesA, Index=panel_14, Wrap=True)
list_item_5 = ListItem(List=sort_list.ValuesValuesA, Index=panel_15, Wrap=True)
list_item_6 = ListItem(List=sort_list.ValuesValuesA, Index=panel_16, Wrap=True)
discontinuity = Discontinuity(Curve=list_item_5, Level=1)  # -> Points, Parameters
discontinuity_2 = Discontinuity(Curve=list_item_4, Level=1)  # -> Points, Parameters
discontinuity_3 = Discontinuity(Curve=list_item_6, Level=1)  # -> Points, Parameters
average = Average(Input=discontinuity.Points)
average_2 = Average(Input=discontinuity_2.Points)
average_3 = Average(Input=discontinuity_3.Points)
shift_paths = ShiftPaths(Data=average, Offset=-1)
shift_paths_2 = ShiftPaths(Data=average_2, Offset=-1)
shift_paths_3 = ShiftPaths(Data=average_3, Offset=-1)
list_item_7 = ListItem(List=simplify(shift_paths), Index=graft(panel_15), Wrap=True)  # -> Item, Item1
list_item_8 = ListItem(List=simplify(shift_paths_2), Index=graft(panel_14), Wrap=True)  # -> Item, Item1
list_item_9 = ListItem(List=simplify(shift_paths_3), Index=graft(panel_16), Wrap=True)  # -> Item, Item1
line = Line(StartPoint=list_item_7.Item, EndPoint=list_item_7.Item1)
line_2 = Line(StartPoint=list_item_8.Item, EndPoint=list_item_8.Item1)
line_3 = Line(StartPoint=list_item_9.Item, EndPoint=list_item_9.Item1)
extend_curve = ExtendCurve(Curve=line, Type=0, Start=number_slider, End=number_slider)
extend_curve_2 = ExtendCurve(Curve=line_2, Type=0, Start=number_slider_2, End=number_slider_2)
extend_curve_3 = ExtendCurve(Curve=line_3, Type=0, Start=number_slider_3, End=number_slider_3)
merge_2 = Merge(Data1=extend_curve, Data2=extend_curve_2, Data3=extend_curve_3)
bounding_box_3 = BoundingBox(Content=merge_2, Plane=PlaneXY(0, 0, 0), UnionBox=True)  # -> Box, Box_2

# ----
# Select top surfaces only
deconstruct_brep_6 = DeconstructBrep(Brep=spatial_element_geometry_2.Geometry)  # -> Faces, Edges, Vertices
area_2 = Area(Geometry=deconstruct_brep_6.Faces)  # -> Area, Centroid
deconstruct_7 = Deconstruct(Point=area_2.Centroid)  # -> XComponent, YComponent, ZComponent
sort_list_2 = SortList(Keys=deconstruct_7.ZComponent, ValuesA=deconstruct_brep_6.Faces)  # -> Keys, ValuesA
list_item_10 = ListItem(List=sort_list_2.ValuesA, Index=0, Wrap=True)  # -> Item1, Item
brep_3 = Brep(list_item_10.Item1)

# ----
# Project rooms and door's top to the elevation of the chosen Revit level,
# so all rooms are in the same height (elevation).
panel_17 = Panel("Elevation")
element_parameter_4 = ElementParameter(Element=level, Parameter=panel_17)  # -> Element, Value
construct_point = ConstructPoint(XCoordinate=0, YCoordinate=0, ZCoordinate=element_parameter_4.Value)
xy_plane = XYPlane(Origin=construct_point)

project = Project(Geometry=brep_3, Plane=xy_plane)  # -> Geometry, Transform

shape_in_brep = ShapeInBrep(Brep=bounding_box_3.Box, Shape=brep)
equality_4 = Equality(FirstNumber=shape_in_brep, SecondNumber=inside)  # -> Equality, Inequality
cull_pattern_5 = CullPattern(List=brep, CullPattern=equality_4.Equality)
area_3 = Area(Geometry=cull_pattern_5)  # -> Area, Centroid
deconstruct_8 = Deconstruct(Point=area_3.Centroid)  # -> XComponent, YComponent, ZComponent
sort_list_3 = SortList(Keys=deconstruct_8.ZComponent, ValuesValuesA=cull_pattern_5)  # -> Keys, ValuesValuesA
list_item_11 = ListItem(List=sort_list_3.ValuesValuesA, Index=0, Wrap=True)  # -> Item1, Item
top_door_surfaces = Surface(list_item_11.Item1)
project_2 = Project(Geometry=top_door_surfaces, Plane=xy_plane)  # -> Geometry, Transform
top_door_surfaces_2 = Surface(project_2.Geometry)
rooms = Brep(project.Geometry)
brep_4 = Brep(flatten([rooms, top_door_surfaces_2]))
clean_tree = CleanTree(RemoveNulls=True, RemoveInvalid=True, RemoveEmpty=False, Tree=brep_4)
extrude = Extrude(Base=clean_tree, Direction=unit_z)
brep_5 = Brep(extrude)
deconstruct_brep_7 = DeconstructBrep(Brep=brep_5)  # -> Faces, Edges, Vertices; disabled

# ---- group: Get Vertices of Bottom Face
point_4 = Point(deconstruct_brep_7.Vertices)  # disabled
deconstruct_9 = Deconstruct(Point=point_4)  # -> XComponent, YComponent, ZComponent; disabled
min_max_4 = MinMax(Number=deconstruct_9.ZComponent)  # -> Minimum, Maximum; disabled
equality_5 = Equality(FirstNumber=deconstruct_9.ZComponent, SecondNumber=min_max_4.Minimum)  # -> Equality, Inequality; disabled
cull_pattern_6 = CullPattern(List=point_4, CullPattern=equality_5.Equality)  # disabled
deconstruct_10 = Deconstruct(Point=cull_pattern_6)  # -> XComponent, YComponent, ZComponent; disabled
python_3_script_19 = Python3Script(x=deconstruct_10.XComponent, y=deconstruct_10.YComponent, z=deconstruct_10.ZComponent)  # -> out, VerticesOfRooms; inputs x: tree of Double, y: tree of Double, z: tree of Double; disabled; same code as python_3_script_6

# ---- group: WIP Trying to construct directly from Faces
python_3_script_20 = Python3Script(Faces=deconstruct_brep_7.Faces, Vertices=deconstruct_brep_7.Vertices)  # -> out, Topology; inputs Faces: tree, Vertices: tree; disabled
# ---------- python_3_script_20: Python ----------
from topologicpy.Topology import Topology

def data_tree_to_nested_list(data_tree, base_retrieval=lambda x: x[0]):
    """
    Converts a Grasshopper DataTree into a nested list structure.
    """
    def extend_list(path, depth, simple_data, nested_list):
        target_index = path[depth]
        if len(nested_list) <= target_index:
            nested_list.extend([None] * (target_index - len(nested_list) + 1))
        
        if depth == path.Length - 1:
            nested_list[target_index] = list(simple_data)
        else:
            if nested_list[target_index] is None:
                nested_list[target_index] = []
            extend_list(path, depth + 1, simple_data, nested_list[target_index])

    nested_structure = []
    for i in range(data_tree.BranchCount):
        branch_path = data_tree.Path(i)
        extend_list(branch_path, 0, data_tree.Branch(branch_path), nested_structure)
    
    return base_retrieval(nested_structure)

# Convert the Grasshopper DataTrees to nested lists
Faces_of_Rooms = data_tree_to_nested_list(Faces)
Vertices_of_Rooms = data_tree_to_nested_list(Vertices)

Topology_out = []

for Room in Faces_of_Rooms:
    topo_Room = Topology.ByGeometry(faces = Room)
    Topology_out.append(topo_Room)
# ---------- end python_3_script_20 ----------

# ----
topology_bygeometry = TopologyByGeometry(Geometry=brep_5, Tolerance=0.0001)  # disabled
panel_18 = Panel(python_3_script_19.out)  # disabled

# ---- group: Generate topo_Faces
python_3_script_21 = Python3Script(VerticesOfRooms=python_3_script_19.VerticesOfRooms)  # -> out, FacesOfRooms; inputs VerticesOfRooms: list; disabled; same code as python_3_script_11

# ---- group: "Extrude" upwards
python_3_script_22 = Python3Script(FacesOfRooms=python_3_script_21.FacesOfRooms, Heigth="2800")  # -> out, flatten(CellsRooms); inputs FacesOfRooms: list, Heigth: Double; disabled; same code as python_3_script_14

# ---- group: Generate CellComplex / Cluster
python_3_script_23 = Python3Script(CellsRooms=python_3_script_22.CellsRooms)  # -> out, CellComplex; inputs CellsRooms: list; disabled; same code as python_3_script_15
python_3_script_24 = Python3Script(CellsRooms=python_3_script_22.CellsRooms)  # -> out, Cluster; inputs CellsRooms: list; disabled; same code as python_3_script_16

# ----
cellcomplex_bycells = CellComplexByCells(Cells=topology_bygeometry)  # disabled

# ---- group: Visualize
python_3_script_25 = Python3Script(topology=python_3_script_23.CellComplex)  # -> out, geometry; disabled; same code as python_3_script_9

# ----
graph_bytopology = GraphByTopology(
    Topology=cellcomplex_bycells,
    Direct=True,
    ViaSharedTopologies=False,
    ViaSharedApertures=False,
    ToExteriorTopologies=False,
    ToExteriorApertures=False,
    UseFaceInternalVertex=False,
    Tolerance=0.0001)  # disabled

# ---- group: Build Graph
python_3_script_26 = Python3Script(x=python_3_script_23.CellComplex)  # -> out, topo_Graph, topo_Graph_Vertices, topo_Graph_Edges; disabled; same code as python_3_script_18

# ----
graph_vertices = GraphVertices(Graph=graph_bytopology)  # disabled
graph_edges = GraphEdges(Graph=graph_bytopology, Vertices=graph_vertices, Tolerance=0.0001)  # disabled

edge_endvertex = EdgeEndVertex(Edge=graph_edges)  # disabled
edge_startvertex = EdgeStartVertex(Edge=graph_edges)  # disabled
topology_geometry = TopologyGeometry(Topology=edge_endvertex, Tolerance=0.0001)  # disabled
topology_geometry_2 = TopologyGeometry(Topology=edge_startvertex, Tolerance=0.0001)  # disabled

# ---- group: Find Start and End Vertices
python_3_script_27 = Python3Script(topo_Graph_edges=python_3_script_26.topo_Graph_Edges)  # -> out, topo_startVertex, topo_endVertex, startPoints, endPoints; inputs topo_Graph_edges: list; disabled
# ---------- python_3_script_27: Python ----------
from topologicpy.Edge import Edge
from topologicpy.Topology import Topology
import Rhino.Geometry as rg

# Initialize lists to store topology and point objects
topo_startVertex, topo_endVertex = [], []
startPoints, endPoints = [], []

# Iterate through each edge in the graph
for edge in topo_Graph_edges:
    # Extract start and end vertices
    sVertex = Edge.StartVertex(edge)
    eVertex = Edge.EndVertex(edge)
    
    # Append Topology vertices to the respective lists
    topo_startVertex.append(sVertex)
    topo_endVertex.append(eVertex)
    
    # Extract coordinates from the vertices
    sGeom = Topology.Geometry(sVertex)['vertices'][0]
    eGeom = Topology.Geometry(eVertex)['vertices'][0]
    
    # Convert coordinates to Point3d objects
    startPoints.append(rg.Point3d(*sGeom))
    endPoints.append(rg.Point3d(*eGeom))

# Outputs: Topology and Point3d objects for start and end vertices
print("Topology Start Vertices:", topo_startVertex)
print("Topology End Vertices:", topo_endVertex)
print("Start Points:", startPoints)
print("End Points:", endPoints)
# ---------- end python_3_script_27 ----------

# ----
ln = Line(StartPoint=topology_geometry_2, EndPoint=topology_geometry)  # disabled
panel_19 = Panel("0.2")  # disabled
swatch_2 = ColourSwatch(SwatchColor=RGB(255, 0, 0))  # disabled
pipe = Pipe(Curve=ln, Radius=panel_19, Caps=1)  # disabled

ln_2 = Line(StartPoint=python_3_script_27.startPoints, EndPoint=python_3_script_27.endPoints)  # disabled
pipe_2 = Pipe(Curve=ln_2, Radius=panel_13, Caps=1)  # disabled
preview = CustomPreview(Geometry=pipe, Material=swatch_2)  # disabled
preview_2 = CustomPreview(Geometry=pipe_2, Material=swatch)  # disabled
